# Dynamo graph Stap 1. schedules aanmaken.dyn (Dynamo 3.0.3.7597)
# packages: archi-lab.net 2025.300.1225, Crumple 2026.8.1

# group: Wanden > Aanmaken schedule
# MaterialTakeoff
categories = Categories("OST_Walls")
code_block = CodeBlock { "MaterialTakeoff, walls"; }
code_block_2 = CodeBlock { "MaterialTakeoff"; }
createSchedule = ScheduleView.CreateSchedule(category=categories, name=code_block, scheduleType=code_block_2)

# group: Wanden > Fields aanmaken
# Family and Type, Material: Name en Material: Volume
schedulableFields = ScheduleView.SchedulableFields(scheduleView=createSchedule)
python_script = Python(IN[0]=schedulableFields)  # CPython3
# ---------- python_script.python (37 lines) ----------
# Load the Python Standard and DesignScript Libraries
import sys
import clr
clr.AddReference('ProtoGeometry')
from Autodesk.DesignScript.Geometry import *

# The inputs to this node will be stored as a list in the IN variables.
dataEnteringNode = IN

# Place your code below this line
import clr
clr.AddReference('RevitAPI')
clr.AddReference('RevitServices')
from Autodesk.Revit.DB import *
from RevitServices.Persistence import DocumentManager

doc = DocumentManager.Instance.CurrentDBDocument
fields = IN[0] if isinstance(IN[0], list) else [IN[0]]

targetNames = [
    "Family and Type",
    "Material: Name",
    "Material: Volume",
    "Function"
]

result = []
for f in fields:
    try:
        if f.Name in targetNames:
            result.append(f)
    except:
        pass

result.sort(key=lambda f: targetNames.index(f.Name))

OUT = result
# ----------------------------------------
addFields = ScheduleView.AddFields(scheduleView=createSchedule, fields=python_script)

# group: Wanden > Sorting / grouping aanmaken
# Material: Name sorteren, calculate aanzetten bij Material: Volume
code_block_3 = CodeBlock { false; }
isItemized = archilab.Revit.Views.ScheduleViews.IsItemized(view=addFields, isItemized=code_block_3)
python_script_2 = Python(IN[0]=isItemized)  # CPython3
# ---------- python_script_2.python (32 lines) ----------
# Load the Python Standard and DesignScript Libraries
import sys
import clr
clr.AddReference('ProtoGeometry')
from Autodesk.DesignScript.Geometry import *

# The inputs to this node will be stored as a list in the IN variables.
dataEnteringNode = IN

# Place your code below this line

import clr
clr.AddReference('RevitAPI')
clr.AddReference('RevitServices')
from Autodesk.Revit.DB import *
from RevitServices.Persistence import DocumentManager
from RevitServices.Transactions import TransactionManager

doc = DocumentManager.Instance.CurrentDBDocument
schedule = UnwrapElement(IN[0])

TransactionManager.Instance.EnsureInTransaction(doc)

definition = schedule.Definition
for fieldId in definition.GetFieldOrder():
    field = definition.GetField(fieldId)
    if field.ColumnHeading == "Material: Volume":
        field.DisplayType = ScheduleFieldDisplayType.Totals
        break

TransactionManager.Instance.TransactionTaskDone()
OUT = schedule
# ----------------------------------------
fields = ScheduleView.Fields(scheduleView=addFields)
code_block_4 = CodeBlock(x=fields) { x[1]; }
string_from_object = FromObject(object=code_block_4)
code_block_5 = CodeBlock { true; }
code_block_6 = CodeBlock { false; }
schedule_sort_order = ScheduleSortOrderUi()  # nothing selected
schedule_sorting_grouping = Custom[Schedule Sorting Grouping](schedule=addFields, parameterName=string_from_object, blankLine=code_block_5, footerCount=code_block_5, footerTitle=code_block_5, header=code_block_6, sortOrder=schedule_sort_order)  # package archi-lab.net; This node will allow you to specify sorting/grouping parameters in schedule as well parameters like sorting order, whether its a footer or header. Visit archi-lab.net for more information.

# group: Daken > Aanmaken schedule
# MaterialTakeoff
categories_2 = Categories("OST_Roofs")
code_block_7 = CodeBlock { "MaterialTakeoff, roofs"; }
code_block_8 = CodeBlock { "MaterialTakeoff"; }
createSchedule_2 = ScheduleView.CreateSchedule(category=categories_2, name=code_block_7, scheduleType=code_block_8)

# group: Daken > Fields aanmaken
# Family and Type, Material: Name en Material: Volume
schedulableFields_2 = ScheduleView.SchedulableFields(scheduleView=createSchedule_2)
python_script_3 = Python(IN[0]=schedulableFields_2)  # CPython3; same code as python_script
addFields_2 = ScheduleView.AddFields(scheduleView=createSchedule_2, fields=python_script_3)

# group: Daken > Sorting / grouping aanmaken
# Material: Name sorteren, calculate aanzetten bij Material: Volume
code_block_9 = CodeBlock { false; }
isItemized_2 = archilab.Revit.Views.ScheduleViews.IsItemized(view=addFields_2, isItemized=code_block_9)
python_script_4 = Python(IN[0]=isItemized_2)  # CPython3; same code as python_script_2
fields_2 = ScheduleView.Fields(scheduleView=addFields_2)
code_block_10 = CodeBlock(x=fields_2) { x[1]; }
string_from_object_2 = FromObject(object=code_block_10)
code_block_11 = CodeBlock { true; }
code_block_12 = CodeBlock { false; }
schedule_sort_order_2 = ScheduleSortOrderUi()  # nothing selected
schedule_sorting_grouping_2 = Custom[Schedule Sorting Grouping](schedule=addFields_2, parameterName=string_from_object_2, blankLine=code_block_11, footerCount=code_block_11, footerTitle=code_block_11, header=code_block_12, sortOrder=schedule_sort_order_2)

# group: Ramen > Aanmaken schedule
# MaterialTakeoff
categories_3 = Categories("OST_Windows")
code_block_13 = CodeBlock { "MaterialTakeoff, windows"; }
code_block_14 = CodeBlock { "MaterialTakeoff"; }
createSchedule_3 = ScheduleView.CreateSchedule(category=categories_3, name=code_block_13, scheduleType=code_block_14)

# group: Ramen > Fields aanmaken
# Family and Type, Material: Name en Material: Volume
schedulableFields_3 = ScheduleView.SchedulableFields(scheduleView=createSchedule_3)
python_script_5 = Python(IN[0]=schedulableFields_3)  # CPython3; same code as python_script
addFields_3 = ScheduleView.AddFields(scheduleView=createSchedule_3, fields=python_script_5)

# group: Ramen > Sorting / grouping aanmaken
# Material: Name sorteren, calculate aanzetten bij Material: Volume
code_block_15 = CodeBlock { false; }
isItemized_3 = archilab.Revit.Views.ScheduleViews.IsItemized(view=addFields_3, isItemized=code_block_15)
python_script_6 = Python(IN[0]=isItemized_3)  # CPython3; same code as python_script_2
fields_3 = ScheduleView.Fields(scheduleView=addFields_3)
code_block_16 = CodeBlock(x=fields_3) { x[1]; }
string_from_object_3 = FromObject(object=code_block_16)
code_block_17 = CodeBlock { true; }
code_block_18 = CodeBlock { false; }
code_block_19 = CodeBlock { "Ascending"; }
schedule_sorting_grouping_3 = Custom[Schedule Sorting Grouping](schedule=addFields_3, parameterName=string_from_object_3, blankLine=code_block_17, footerCount=code_block_17, footerTitle=code_block_17, header=code_block_18, sortOrder=code_block_19)

# group: Curtain walls > Aanmaken schedule
# MaterialTakeoff
categories_4 = Categories("OST_CurtainWallMullions")
code_block_20 = CodeBlock { "MaterialTakeoff, curtain walls"; }
code_block_21 = CodeBlock { "MaterialTakeoff"; }
createSchedule_4 = ScheduleView.CreateSchedule(category=categories_4, name=code_block_20, scheduleType=code_block_21)

# group: Curtain walls > Fields aanmaken
# Family and Type, Material: Name en Material: Volume
schedulableFields_4 = ScheduleView.SchedulableFields(scheduleView=createSchedule_4)
python_script_7 = Python(IN[0]=schedulableFields_4)  # CPython3; same code as python_script
addFields_4 = ScheduleView.AddFields(scheduleView=createSchedule_4, fields=python_script_7)

# group: Curtain walls > Sorting / grouping aanmaken
# Material: Name sorteren, calculate aanzetten bij Material: Volume
code_block_22 = CodeBlock { false; }
isItemized_4 = archilab.Revit.Views.ScheduleViews.IsItemized(view=addFields_4, isItemized=code_block_22)
python_script_8 = Python(IN[0]=isItemized_4)  # CPython3; same code as python_script_2
fields_4 = ScheduleView.Fields(scheduleView=addFields_4)
code_block_23 = CodeBlock(x=fields_4) { x[1]; }
string_from_object_4 = FromObject(object=code_block_23)
code_block_24 = CodeBlock { true; }
code_block_25 = CodeBlock { false; }
code_block_26 = CodeBlock { "Ascending"; }
schedule_sorting_grouping_4 = Custom[Schedule Sorting Grouping](schedule=addFields_4, parameterName=string_from_object_4, blankLine=code_block_24, footerCount=code_block_24, footerTitle=code_block_24, header=code_block_25, sortOrder=code_block_26)

# group: Deuren > Aanmaken schedule
# MaterialTakeoff
categories_5 = Categories("OST_Doors")
code_block_27 = CodeBlock { "MaterialTakeoff, door"; }
code_block_28 = CodeBlock { "MaterialTakeoff"; }
createSchedule_5 = ScheduleView.CreateSchedule(category=categories_5, name=code_block_27, scheduleType=code_block_28)

# group: Deuren > Fields aanmaken
# Family and Type, Material: Name en Material: Volume
schedulableFields_5 = ScheduleView.SchedulableFields(scheduleView=createSchedule_5)
python_script_9 = Python(IN[0]=schedulableFields_5)  # CPython3; same code as python_script
addFields_5 = ScheduleView.AddFields(scheduleView=createSchedule_5, fields=python_script_9)

# group: Deuren > Sorting / grouping aanmaken
# Material: Name sorteren, calculate aanzetten bij Material: Volume
code_block_29 = CodeBlock { false; }
isItemized_5 = archilab.Revit.Views.ScheduleViews.IsItemized(view=addFields_5, isItemized=code_block_29)
python_script_10 = Python(IN[0]=isItemized_5)  # CPython3; same code as python_script_2
fields_5 = ScheduleView.Fields(scheduleView=addFields_5)
code_block_30 = CodeBlock(x=fields_5) { x[1]; }
string_from_object_5 = FromObject(object=code_block_30)
code_block_31 = CodeBlock { true; }
code_block_32 = CodeBlock { false; }
code_block_33 = CodeBlock { "Ascending"; }
schedule_sorting_grouping_5 = Custom[Schedule Sorting Grouping](schedule=addFields_5, parameterName=string_from_object_5, blankLine=code_block_31, footerCount=code_block_31, footerTitle=code_block_31, header=code_block_32, sortOrder=code_block_33)

# group: Vloeren > Aanmaken schedule
# MaterialTakeoff
categories_6 = Categories("OST_Floors")
code_block_34 = CodeBlock { "MaterialTakeoff, floor"; }
code_block_35 = CodeBlock { "MaterialTakeoff"; }
createSchedule_6 = ScheduleView.CreateSchedule(category=categories_6, name=code_block_34, scheduleType=code_block_35)

# group: Vloeren > Fields aanmaken
# Family and Type, Material: Name en Material: Volume
schedulableFields_6 = ScheduleView.SchedulableFields(scheduleView=createSchedule_6)
python_script_11 = Python(IN[0]=schedulableFields_6)  # CPython3; same code as python_script
addFields_6 = ScheduleView.AddFields(scheduleView=createSchedule_6, fields=python_script_11)

# group: Vloeren > Sorting / grouping aanmaken
# Material: Name sorteren, calculate aanzetten bij Material: Volume
code_block_36 = CodeBlock { false; }
isItemized_6 = archilab.Revit.Views.ScheduleViews.IsItemized(view=addFields_6, isItemized=code_block_36)
python_script_12 = Python(IN[0]=isItemized_6)  # CPython3; same code as python_script_2
fields_6 = ScheduleView.Fields(scheduleView=addFields_6)
code_block_37 = CodeBlock(x=fields_6) { x[1]; }
string_from_object_6 = FromObject(object=code_block_37)
code_block_38 = CodeBlock { true; }
code_block_39 = CodeBlock { false; }
code_block_40 = CodeBlock { "Ascending"; }
schedule_sorting_grouping_6 = Custom[Schedule Sorting Grouping](schedule=addFields_6, parameterName=string_from_object_6, blankLine=code_block_38, footerCount=code_block_38, footerTitle=code_block_38, header=code_block_39, sortOrder=code_block_40)

# group: Plafonds > Aanmaken schedule
# MaterialTakeoff
categories_7 = Categories("OST_Ceilings")
code_block_41 = CodeBlock { "MaterialTakeoff, ceilings"; }
code_block_42 = CodeBlock { "MaterialTakeoff"; }
createSchedule_7 = ScheduleView.CreateSchedule(category=categories_7, name=code_block_41, scheduleType=code_block_42)

# group: Plafonds > Fields aanmaken
# Family and Type, Material: Name en Material: Volume
schedulableFields_7 = ScheduleView.SchedulableFields(scheduleView=createSchedule_7)
python_script_13 = Python(IN[0]=schedulableFields_7)  # CPython3; same code as python_script
addFields_7 = ScheduleView.AddFields(scheduleView=createSchedule_7, fields=python_script_13)

# group: Plafonds > Sorting / grouping aanmaken
# Material: Name sorteren, calculate aanzetten bij Material: Volume
code_block_43 = CodeBlock { false; }
isItemized_7 = archilab.Revit.Views.ScheduleViews.IsItemized(view=addFields_7, isItemized=code_block_43)
python_script_14 = Python(IN[0]=isItemized_7)  # CPython3; same code as python_script_2
fields_7 = ScheduleView.Fields(scheduleView=addFields_7)
code_block_44 = CodeBlock(x=fields_7) { x[1]; }
string_from_object_7 = FromObject(object=code_block_44)
code_block_45 = CodeBlock { true; }
code_block_46 = CodeBlock { false; }
code_block_47 = CodeBlock { "Ascending"; }
schedule_sorting_grouping_7 = Custom[Schedule Sorting Grouping](schedule=addFields_7, parameterName=string_from_object_7, blankLine=code_block_45, footerCount=code_block_45, footerTitle=code_block_45, header=code_block_46, sortOrder=code_block_47)

# group: Kolommen > Aanmaken schedule
# MaterialTakeoff
categories_8 = Categories("OST_Columns")
code_block_48 = CodeBlock { "MaterialTakeoff, columns"; }
code_block_49 = CodeBlock { "MaterialTakeoff"; }
createSchedule_8 = ScheduleView.CreateSchedule(category=categories_8, name=code_block_48, scheduleType=code_block_49)

# group: Kolommen > Fields aanmaken
# Family and Type, Material: Name en Material: Volume
schedulableFields_8 = ScheduleView.SchedulableFields(scheduleView=createSchedule_8)
python_script_15 = Python(IN[0]=schedulableFields_8)  # CPython3; same code as python_script
addFields_8 = ScheduleView.AddFields(scheduleView=createSchedule_8, fields=python_script_15)

# group: Kolommen > Sorting / grouping aanmaken
# Material: Name sorteren, calculate aanzetten bij Material: Volume
code_block_50 = CodeBlock { false; }
isItemized_8 = archilab.Revit.Views.ScheduleViews.IsItemized(view=addFields_8, isItemized=code_block_50)
python_script_16 = Python(IN[0]=isItemized_8)  # CPython3; same code as python_script_2
fields_8 = ScheduleView.Fields(scheduleView=addFields_8)
code_block_51 = CodeBlock(x=fields_8) { x[1]; }
string_from_object_8 = FromObject(object=code_block_51)
code_block_52 = CodeBlock { true; }
code_block_53 = CodeBlock { false; }
code_block_54 = CodeBlock { "Ascending"; }
schedule_sorting_grouping_8 = Custom[Schedule Sorting Grouping](schedule=addFields_8, parameterName=string_from_object_8, blankLine=code_block_52, footerCount=code_block_52, footerTitle=code_block_52, header=code_block_53, sortOrder=code_block_54)

# group: Trappen > Aanmaken schedule
# MaterialTakeoff
categories_9 = Categories("OST_Stairs")
code_block_55 = CodeBlock { "MaterialTakeoff, stairs"; }
code_block_56 = CodeBlock { "MaterialTakeoff"; }
createSchedule_9 = ScheduleView.CreateSchedule(category=categories_9, name=code_block_55, scheduleType=code_block_56)

# group: Trappen > Fields aanmaken
# Family and Type, Material: Name en Material: Volume
schedulableFields_9 = ScheduleView.SchedulableFields(scheduleView=createSchedule_9)
python_script_17 = Python(IN[0]=schedulableFields_9)  # CPython3; same code as python_script
addFields_9 = ScheduleView.AddFields(scheduleView=createSchedule_9, fields=python_script_17)

# group: Trappen > Sorting / grouping aanmaken
# Material: Name sorteren, calculate aanzetten bij Material: Volume
code_block_57 = CodeBlock { false; }
isItemized_9 = archilab.Revit.Views.ScheduleViews.IsItemized(view=addFields_9, isItemized=code_block_57)
python_script_18 = Python(IN[0]=isItemized_9)  # CPython3; same code as python_script_2
fields_9 = ScheduleView.Fields(scheduleView=addFields_9)
code_block_58 = CodeBlock(x=fields_9) { x[1]; }
string_from_object_9 = FromObject(object=code_block_58)
code_block_59 = CodeBlock { true; }
code_block_60 = CodeBlock { false; }
code_block_61 = CodeBlock { "Ascending"; }
schedule_sorting_grouping_9 = Custom[Schedule Sorting Grouping](schedule=addFields_9, parameterName=string_from_object_9, blankLine=code_block_59, footerCount=code_block_59, footerTitle=code_block_59, header=code_block_60, sortOrder=code_block_61)

# group: Schedule venster na run van stap 1
# Schedules aangemaakt of schedules niet aangemaakt als output
code_block_62 = CodeBlock { "Schedules"; }
list_create = List.Create(item0=schedule_sorting_grouping, item1=schedule_sorting_grouping_2, item2=schedule_sorting_grouping_3, item3=schedule_sorting_grouping_4, item4=schedule_sorting_grouping_5, item5=schedule_sorting_grouping_6, item6=schedule_sorting_grouping_7, item7=schedule_sorting_grouping_8, item8=schedule_sorting_grouping_9)
flow_waitfor = Custom[© Flow.WaitFor](data=list_create, waitFor=list_create)  # package Crumple; Tells the first input to wait for the second input to arrive, then passes on the first input. Really useful for scripts which have branching paths that rely on their outputs to carry each other forward. Quite a few custom packages have a 'passthrough' or 'waitfor' node. I use these all the time, so find it useful to have them contained in this package also.
python_script_19 = Python(IN[0]=flow_waitfor)  # CPython3
# ---------- python_script_19.python (19 lines) ----------
# Load the Python Standard and DesignScript Libraries
import sys
import clr
clr.AddReference('ProtoGeometry')
from Autodesk.DesignScript.Geometry import *

# The inputs to this node will be stored as a list in the IN variables.
dataEnteringNode = IN

# Place your code below this line

lst = IN[0]

aantal_nullen = lst.count(0)

if aantal_nullen > 0:
    OUT = "Schedules aangemaakt"
else:
    OUT = "Schedules niet aangemaakt"
# ----------------------------------------
ui_messenger = Custom[© UI.Messenger](title=code_block_62, body=python_script_19)  # package Crumple; Displays a message box with a title/body and OK/cancel button. If OK is selected, the third input's data will be passed through.
