# Dynamo graph Stap 2. data exporteren.dyn "Stap 2. data exporteren." (Dynamo 3.0.3.7597)
# packages: Crumple 2026.8.1

# group: Input exporteer venster
# Gebruikersoptie voor welke schedules hij / zij wil exporteren en de input van een excel bestand van de gebruiker
collect_schedulesbytype = Custom[© Collect.SchedulesByType]()  # package Crumple; Returns all schedules in a document, separated into key and non-key schedules.
name = Element.Name(element=collect_schedulesbytype.schedules)
code_block = CodeBlock { "MaterialTakeoff"; false; }
contains = String.Contains(string=name, searchFor=code_block.out0, ignoreCase=code_block.out1)
filterByBoolMask = List.FilterByBoolMask(list=collect_schedulesbytype.schedules, mask=contains)
code_block_2 = CodeBlock { ""; }
boolean = BoolSelector(true)  # graph output

# group: Exporteer venster
# Gepersonaliseerd naar wens van HU info en gebruikersvriendelijk
python_script = Python(IN[0]=filterByBoolMask.in, IN[1]=code_block_2, IN[2]=boolean)  # IronPython2
# ---------- python_script.python (254 lines) ----------
import sys
import clr
clr.AddReference('ProtoGeometry')
from Autodesk.DesignScript.Geometry import *

clr.AddReference('System.Windows.Forms')
clr.AddReference('System.Drawing')
from System.Windows.Forms import *
from System.Drawing import *
from System.IO import File, MemoryStream
from System import Convert

# ---- INPUTS ----
input_data = IN[0]
if hasattr(input_data, 'Keys'):
    schedule_names = list(input_data.Keys)
else:
    schedule_names = list(input_data) if input_data else []

fp_input = IN[1]
if hasattr(fp_input, 'FilePath'):
    default_path = str(fp_input.FilePath)
elif fp_input is not None:
    default_path = str(fp_input)
else:
    default_path = ""

toggle_default = IN[2] if IN[2] is not None else True

# ---- HU LOGO ALS BASE64 (geen extern bestand nodig) ----
LOGO_B64 = "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"

# ---- KLEUREN HU HUISSTIJL ----
hu_blauw = Color.FromArgb(30, 170, 220)
hu_rood  = Color.FromArgb(190, 30, 45)

# ---- DYNAMISCHE HOOGTES ----
item_height   = 18
min_list_h    = 80
max_list_h    = 300
list_height   = max(min_list_h, min(max_list_h, len(schedule_names) * item_height + 10))

y_sep_top     = 76
y_title       = y_sep_top + 12
y_lbl_list    = y_title + 30
y_chk_all     = y_lbl_list + 22
y_clb         = y_chk_all + 26
y_fp_lbl      = y_clb + list_height + 16
y_fp_txt      = y_fp_lbl + 22
y_toggle      = y_fp_txt + 44
y_sep_bot     = y_toggle + 44
y_knoppen     = y_sep_bot + 18
form_height   = y_knoppen + 60


# ---- FORM ----
form = Form()
form.Text = "Export schedule"
form.Width = 600
form.Height = form_height + 60
form.StartPosition = FormStartPosition.CenterScreen
form.TopMost = True
form.FormBorderStyle = FormBorderStyle.FixedDialog
form.MaximizeBox = False
form.BackColor = Color.White
form.ForeColor = Color.FromArgb(30, 30, 30)

# ---- STREEP LINKS ----
half = form_height // 2
streep_blauw = Panel()
streep_blauw.Location = Point(0, 0)
streep_blauw.Size = Size(8, half)
streep_blauw.BackColor = hu_blauw
form.Controls.Add(streep_blauw)

streep_rood = Panel()
streep_rood.Location = Point(0, half)
streep_rood.Size = Size(8, form_height - half)
streep_rood.BackColor = hu_rood
form.Controls.Add(streep_rood)

# ---- LOGO ----
try:
    img_bytes = Convert.FromBase64String(LOGO_B64)
    ms = MemoryStream(img_bytes)
    logo_img = Image.FromStream(ms)
    logo_box = PictureBox()
    logo_box.Image = logo_img
    logo_box.SizeMode = PictureBoxSizeMode.Zoom
    logo_box.Location = Point(20, 12)
    logo_box.Size = Size(160, 55)
    logo_box.BackColor = Color.White
    form.Controls.Add(logo_box)
except:
    lbl_logo = Label()
    lbl_logo.Text = "HOGESCHOOL UTRECHT"
    lbl_logo.ForeColor = hu_blauw
    lbl_logo.Location = Point(20, 18)
    lbl_logo.Size = Size(300, 22)
    form.Controls.Add(lbl_logo)

# ---- SCHEIDINGSLIJN BOVEN ----
sep_top = Panel()
sep_top.Location = Point(8, y_sep_top)
sep_top.Size = Size(566, 1)
sep_top.BackColor = Color.FromArgb(210, 210, 210)
form.Controls.Add(sep_top)

# ---- TITEL ----
lbl_title = Label()
lbl_title.Text = "Export schedule"
lbl_title.Location = Point(20, y_title)
lbl_title.Size = Size(540, 24)
form.Controls.Add(lbl_title)

# ---- SCHEDULE LABEL ----
lbl_list = Label()
lbl_list.Text = "Schedule (selecteer een of meerdere)"
lbl_list.Location = Point(20, y_lbl_list)
lbl_list.Size = Size(540, 18)
lbl_list.ForeColor = Color.FromArgb(80, 80, 80)
form.Controls.Add(lbl_list)

# ---- ALLES SELECTEREN ----
chk_all = CheckBox()
chk_all.Text = "Alles selecteren"
chk_all.ThreeState = True
chk_all.Location = Point(20, y_chk_all)
chk_all.Size = Size(540, 22)
form.Controls.Add(chk_all)

# ---- CHECKED LISTBOX ----
clb = CheckedListBox()
clb.Location = Point(20, y_clb)
clb.Size = Size(550, list_height)
clb.BackColor = Color.FromArgb(250, 250, 250)
clb.ForeColor = Color.FromArgb(30, 30, 30)
clb.BorderStyle = BorderStyle.FixedSingle
clb.CheckOnClick = True

for item in schedule_names:
    if hasattr(item, 'Name'):
        clb.Items.Add(item.Name, False)
    else:
        clb.Items.Add(str(item), False)

form.Controls.Add(clb)

# ---- ALLES SELECTEREN LOGICA ----
def toggle_all(s, e):
    check = chk_all.Checked
    for i in range(clb.Items.Count):
        clb.SetItemChecked(i, check)

chk_all.CheckedChanged += toggle_all

def item_check(s, e):
    all_checked = all(clb.GetItemChecked(i) for i in range(clb.Items.Count))
    none_checked = not any(clb.GetItemChecked(i) for i in range(clb.Items.Count))
    chk_all.CheckedChanged -= toggle_all
    if all_checked:
        chk_all.CheckState = CheckState.Checked
    elif none_checked:
        chk_all.CheckState = CheckState.Unchecked
    else:
        chk_all.CheckState = CheckState.Indeterminate
    chk_all.CheckedChanged += toggle_all

clb.ItemCheck += item_check

# ---- FILEPATH ----
lbl_fp = Label()
lbl_fp.Text = "Bestand recovery rate - Kies het excel bestand..."
lbl_fp.Location = Point(20, y_fp_lbl)
lbl_fp.Size = Size(540, 18)
lbl_fp.ForeColor = Color.FromArgb(80, 80, 80)
form.Controls.Add(lbl_fp)

txt_path = TextBox()
txt_path.Text = default_path
txt_path.Location = Point(20, y_fp_txt)
txt_path.Size = Size(420, 26)
txt_path.BackColor = Color.FromArgb(250, 250, 250)
txt_path.BorderStyle = BorderStyle.FixedSingle
form.Controls.Add(txt_path)

btn_browse = Button()
btn_browse.Text = "..."
btn_browse.Location = Point(450, y_fp_txt - 2)
btn_browse.Size = Size(120, 28)
btn_browse.BackColor = Color.FromArgb(230, 230, 230)
btn_browse.FlatStyle = FlatStyle.Flat

def browse_click(s, e):
    ofd = OpenFileDialog()
    ofd.Filter = "Excel bestanden (*.xlsx;*.xls)|*.xlsx;*.xls|Alle bestanden (*.*)|*.*"
    if ofd.ShowDialog() == DialogResult.OK:
        txt_path.Text = ofd.FileName

btn_browse.Click += browse_click
form.Controls.Add(btn_browse)

# ---- TOGGLE ----
chk_toggle = CheckBox()
chk_toggle.Text = "Actief"
chk_toggle.Checked = toggle_default if isinstance(toggle_default, bool) else True
chk_toggle.Location = Point(20, y_toggle)
chk_toggle.Size = Size(200, 24)
form.Controls.Add(chk_toggle)

# ---- SCHEIDINGSLIJN ONDER ----
sep_bot = Panel()
sep_bot.Location = Point(8, y_sep_bot)
sep_bot.Size = Size(566, 1)
sep_bot.BackColor = Color.FromArgb(210, 210, 210)
form.Controls.Add(sep_bot)

# ---- KNOPPEN ----
btn_ok = Button()
btn_ok.Text = "Exporteren"
btn_ok.Size = Size(130, 36)
btn_ok.Location = Point(20, y_knoppen)
btn_ok.BackColor = hu_blauw
btn_ok.ForeColor = Color.White
btn_ok.FlatStyle = FlatStyle.Flat
btn_ok.DialogResult = DialogResult.OK
form.Controls.Add(btn_ok)

btn_cancel = Button()
btn_cancel.Text = "Annuleren"
btn_cancel.Size = Size(130, 36)
btn_cancel.Location = Point(165, y_knoppen)
btn_cancel.BackColor = Color.FromArgb(230, 230, 230)
btn_cancel.FlatStyle = FlatStyle.Flat
btn_cancel.DialogResult = DialogResult.Cancel
form.Controls.Add(btn_cancel)

form.AcceptButton = btn_ok
form.CancelButton = btn_cancel

# ---- RESULTAAT ----
was_cancelled = True
user_inputs = None

if form.ShowDialog() == DialogResult.OK:
    was_cancelled = False
    selected = [clb.Items[i] for i in range(clb.Items.Count) if clb.GetItemChecked(i)]
    user_inputs = {
        "Schedules": selected,
        "FilePath":  txt_path.Text,
        "Toggle":    chk_toggle.Checked
    }

OUT = [user_inputs, not was_cancelled, was_cancelled]
# ----------------------------------------
code_block_3 = CodeBlock(x=python_script)
# ---------- code_block_3.designscript (6 lines) ----------
x[0];
 // User inputs;
x[1];
 // Was Run;
x[2];
 // Was Cancelled;
# ----------------------------------------

# group: Script resultaten venster
# Run gelukt, run geannuleerd of run afgebroken
code_block_4 = CodeBlock { "Script resultaten"; }
python_script_2 = Python(IN[0]=code_block_3.out1, IN[1]=code_block_3.out2)  # CPython3
# ---------- python_script_2.python (20 lines) ----------
# Load the Python Standard and DesignScript Libraries
import sys
import clr
clr.AddReference('ProtoGeometry')
from Autodesk.DesignScript.Geometry import *

# The inputs to this node will be stored as a list in the IN variables.
dataEnteringNode = IN

# Place your code below this line

wasRun = IN[0]
wasCancelled = IN[1]

if wasCancelled:
    OUT = "Run geannuleerd"
elif wasRun:
    OUT = "Run gelukt"
else:
    OUT = "Run afgebroken"
# ----------------------------------------
code_block_5 = CodeBlock(x=code_block_3.out0) { sched  = x["Schedules"]; path   = x["FilePath"]; toggle = x["Toggle"]; }

# group: Script resultaten venster > Info element -> materiaal
# Informatie omzetten naar materiaalcategoriën voor excel ouput
python_script_3 = Python(IN[0]=filterByBoolMask.in, IN[1]=code_block_5.sched, IN[2]=code_block_5.path, IN[3]=code_block_3.out1)  # CPython3
# ---------- python_script_3.python (273 lines) ----------
# Load the Python Standard and DesignScript Libraries
import sys
import clr
clr.AddReference('ProtoGeometry')
from Autodesk.DesignScript.Geometry import *

# The inputs to this node will be stored as a list in the IN variables.
dataEnteringNode = IN

# Place your code below this line

import clr
import sys
import re

clr.AddReference('RevitAPI')
clr.AddReference('RevitServices')
from Autodesk.Revit.DB import *
from RevitServices.Persistence import DocumentManager

import openpyxl
from openpyxl.styles import Font, PatternFill, Alignment

alleSchedules = IN[0] if isinstance(IN[0], list) else [IN[0]]
geselecteerd  = IN[1] if isinstance(IN[1], list) else [IN[1]]
filePath      = IN[2]
wasRun        = IN[3]

if not wasRun:
    OUT = "Niet uitgevoerd"
else:
    doc = DocumentManager.Instance.CurrentDBDocument

    # Afvlakken als geneste lijst
    raw = []
    for item in alleSchedules:
        if isinstance(item, list):
            raw.extend(item)
        else:
            raw.append(item)

    # Extraheer naam uit "ScheduleView[Name = MaterialTakeoff, walls ]"
    geselecteerdeNamen = []
    for s in geselecteerd:
        tekst = str(s)
        # Probeer naam uit ScheduleView object te halen
        if hasattr(s, 'Name'):
            geselecteerdeNamen.append(s.Name)
        elif "Name = " in tekst:
            naam = re.sub(r'[\]\)]+$', '', tekst.split("Name = ")[1]).strip()
            geselecteerdeNamen.append(naam)
        else:
            geselecteerdeNamen.append(tekst.strip())

    # Filter Revit objecten op geselecteerde namen
    schedules = [s for s in raw if s.Name in geselecteerdeNamen]

    # Tabbladnamen koppeling
    tabMap = {
        "MaterialTakeoff, ceilings":      "Plafonds",
        "MaterialTakeoff, columns":       "Kolommen",
        "MaterialTakeoff, curtain walls": "Gevelpanelen",
        "MaterialTakeoff, door":          "Deuren",
        "MaterialTakeoff, floor":         "Vloeren",
        "MaterialTakeoff, roofs":         "Daken",
        "MaterialTakeoff, walls":         "Wanden",
        "MaterialTakeoff, windows":       "Ramen",
        "MaterialTakeoff, stairs":        "Trappen",
    }
    herkomstNamen = list(tabMap.values())

    # Categorieën
    categorieen = {
        "Beton":     ["systeemvloer", "gewapend", "concrete", "prefab_beton", "beton_prefab", "cellenbeton", "f2_beton", "f4_cellenb", "beton", "cement"],
        "Hout":      ["wood", "timber", "triplex", "hardhout", "vuren", "larikshout", "douglashout", "multiplex", "hsb", "hout", "mdf", "osb"],
        "Isolatie":  ["insulation", "isolatie", "glaswol", "mineraalwol", "steenwol", "eps", "xps", "pur", "pir"],
        "Staal":     ["steel", "staal", "metaal", "zink", "verzinkt", "galvanized"],
        "Bitumen":   ["bitumen", "bitumineus", "roofing", "dakbedekking", "dakleer", "sbs", "app"],
        "Koper":     ["koper", "copper"],
        "Aluminium": ["aluminium", "alu", "aluminum"],
        "Keramiek":  ["_mw_", "halfst", "koppen", "verband", "kalkzandsteen", "keramiek", "keramisch", "ceramic", "tegel", "tegelwerk", "dakpan", "dakpannen"],
        "Afwerking": ["stucwerk", "spuitwerk", "gips", "verf", "coating"],
        "Overig":    []
    }

    def get_categorie(naam):
        naam_lower = naam.lower()
        for cat, keywords in categorieen.items():
            if cat == "Overig":
                continue
            for kw in keywords:
                if kw in naam_lower:
                    return cat
        return "Overig"

    def parse_volume(waarde):
        if waarde is None:
            return 0.0
        tekst = str(waarde).strip()
        tekst = tekst.replace("m³", "").replace("m3", "").strip()
        tekst = tekst.replace(",", ".")
        tekst = re.sub(r'\.(?=\d{3})', '', tekst)
        try:
            return float(tekst)
        except:
            return 0.0

    # Stap 1: data uitlezen uit Revit schedules
    data = {cat: {h: 0.0 for h in herkomstNamen} for cat in categorieen}
    detailData = {cat: [] for cat in categorieen}

    for schedule in schedules:
        schedName     = schedule.Name
        herkomst      = tabMap.get(schedName, schedName)
        revitSchedule = schedule.InternalElement

        tableData   = revitSchedule.GetTableData()
        sectionData = tableData.GetSectionData(SectionType.Body)
        rows        = sectionData.NumberOfRows
        cols        = sectionData.NumberOfColumns

        # Zoek kolom indices op basis van header rij
        matNaamCol = None
        matVolCol  = None
        for c in range(cols):
            header = revitSchedule.GetCellText(SectionType.Body, 0, c).strip()
            if "Material: Name" in header or "Materiaal" in header:
                matNaamCol = c
            if "Material: Volume" in header or "Volume" in header:
                matVolCol = c

        if matNaamCol is None or matVolCol is None:
            continue

        for r in range(1, rows):
            matNaam = revitSchedule.GetCellText(SectionType.Body, r, matNaamCol).strip()
            matVol  = revitSchedule.GetCellText(SectionType.Body, r, matVolCol).strip()

            if not matNaam or matNaam in ["<varies>"] or matNaam.startswith("<"):
                continue

            volume = parse_volume(matVol)
            if volume == 0.0:
                continue

            cat = get_categorie(matNaam)

            data[cat][herkomst] += volume

            # DETAIL REGEL OPSLAAN (nieuw)
            detailData[cat].append([
                herkomst,
                volume,
                matNaam,
                schedName,
            ])

    # Stap 2: Excel opbouwen
    wb = openpyxl.load_workbook(filePath)

    # Stijlen
    headerFont  = Font(bold=True, color="FFFFFF")
    headerFill  = PatternFill("solid", fgColor="196B24")
    totaalFont  = Font(bold=True)
    totaalFill  = PatternFill("solid", fgColor="C1F0C8")
    centerAlign = Alignment(horizontal="center")

    # Stap 3: per categorie de waarden overschrijven
    categorieTabs = []
    for cat in categorieen:
        volumes = data[cat]
        tabNaam = cat + "-data"
        categorieTabs.append(tabNaam)

        if tabNaam not in wb.sheetnames:
            ws = wb.create_sheet(tabNaam)
        else:
            ws = wb[tabNaam]

        # ── Altijd: header + totaalrij + volumedata schrijven ──
        ws["A1"] = "Herkomst"
        ws["B1"] = "Volume (m³)"
        for cel in ["A1", "B1"]:
            ws[cel].font      = headerFont
            ws[cel].fill      = headerFill
            ws[cel].alignment = centerAlign
        ws["A2"] = "Totaal"
        ws["B2"] = f"=SUM(B3:B{2 + len(herkomstNamen)})"
        ws["A2"].font = totaalFont
        ws["B2"].font = totaalFont
        ws["A2"].fill = totaalFill
        ws["B2"].fill = totaalFill
        for i, herkomst in enumerate(herkomstNamen):
            rij = i + 3
            ws[f"A{rij}"] = herkomst
            ws[f"B{rij}"] = round(volumes[herkomst], 2)
        ws.column_dimensions["A"].width = 20
        ws.column_dimensions["B"].width = 15
        ws.column_dimensions["C"].width = 35
        ws.column_dimensions["D"].width = 35

        # ── Altijd: detailtabel schrijven (overschrijft vorige inhoud) ──
        startRow = len(herkomstNamen) + 6

        ws.cell(startRow, 1).value = "DETAIL REGELS (bron: schedules)"
        ws.cell(startRow, 1).font  = headerFont

        headers = ["Herkomst", "Volume", "Materiaal", "Schedule"]
        for i, h in enumerate(headers):
            c = ws.cell(startRow + 1, i + 1)
            c.value     = h
            c.font      = headerFont
            c.fill      = headerFill
            c.alignment = centerAlign

        for i, row in enumerate(detailData[cat]):
            r = startRow + 2 + i
            ws.cell(r, 1).value = row[0]          # herkomst
            ws.cell(r, 2).value = round(row[1], 3) # volume
            ws.cell(r, 3).value = row[2]           # materiaal
            ws.cell(r, 4).value = row[3]           # schedule

        # Altijd volledige inhoud en opmaak schrijven
        ws["A1"] = "Herkomst"
        ws["B1"] = "Volume (m³)"
        for cel in ["A1", "B1"]:
            ws[cel].font      = headerFont
            ws[cel].fill      = headerFill
            ws[cel].alignment = centerAlign
        ws["A2"] = "Totaal"
        ws["B2"] = f"=SUM(B3:B{2 + len(herkomstNamen)})"
        ws["A2"].font = totaalFont
        ws["B2"].font = totaalFont
        ws["A2"].fill = totaalFill
        ws["B2"].fill = totaalFill
        for i, herkomst in enumerate(herkomstNamen):
            rij = i + 3
            ws[f"A{rij}"] = herkomst
            ws[f"B{rij}"] = round(volumes[herkomst], 2)
        ws.column_dimensions["A"].width = 20
        ws.column_dimensions["B"].width = 15
        ws.column_dimensions["C"].width = 35
        ws.column_dimensions["D"].width = 35
        
    # Stap 4: Samenvatting tabblad
    if "Samenvatting-data" not in wb.sheetnames:
        ws_sam = wb.create_sheet("Samenvatting-data", 2)
        ws_sam["A1"] = "Categorie"
        ws_sam["B1"] = "Volume (m³)"
        for cel in ["A1", "B1"]:
            ws_sam[cel].font      = headerFont
            ws_sam[cel].fill      = headerFill
            ws_sam[cel].alignment = centerAlign
        ws_sam["A2"] = "Totaal"
        ws_sam["B2"] = f"=SUM(B3:B{2 + len(categorieTabs)})"
        ws_sam["A2"].font = totaalFont
        ws_sam["B2"].font = totaalFont
        ws_sam["A2"].fill = totaalFill
        ws_sam["B2"].fill = totaalFill
        for i, tabNaam in enumerate(categorieTabs):
            rij = i + 3
            ws_sam[f"A{rij}"] = tabNaam.replace("-data", "")
            ws_sam[f"B{rij}"] = f"='{tabNaam}'!B2"
        ws_sam.column_dimensions["A"].width = 20
        ws_sam.column_dimensions["B"].width = 15
    else:
        ws_sam = wb["Samenvatting-data"]
        for i, tabNaam in enumerate(categorieTabs):
            rij = i + 3
            ws_sam[f"B{rij}"] = f"='{tabNaam}'!B2"

    wb.save(filePath)
    OUT = "Klaar! Tabbladen bijgewerkt: Samenvatting + " + ", ".join(categorieTabs)
# ----------------------------------------
flow_waitfor = Custom[© Flow.WaitFor](data=python_script_2, waitFor=python_script_3)  # package Crumple; Tells the first input to wait for the second input to arrive, then passes on the first input. Really useful for scripts which have branching paths that rely on their outputs to carry each other forward. Quite a few custom packages have a 'passthrough' or 'waitfor' node. I use these all the time, so find it useful to have them contained in this package also.

# group (continued): Script resultaten venster
ui_messenger = Custom[© UI.Messenger](title=code_block_4, body=flow_waitfor)  # package Crumple; Displays a message box with a title/body and OK/cancel button. If OK is selected, the third input's data will be passed through.
